# Grasshopper definition 130409_cluster_and_animation_tutorials_v1-572274.gh (Grasshopper 0.9.14)

geo = Geometry(<curve referenced from the Rhino model>)
linehatcher = LineHatcher(
    inputline=geo,
    divisionlengths=Slider(0.46, range=0.1..3),
    lineangle=Slider(42, range=0..100),
    linelength=Slider(0.3, range=0..3))
geo_2 = Geometry(linehatcher)

# ----
# Animation Frames
animation_frame = Slider(8, range=0..24)
bake_with_attributes = BooleanToggle(False)
geo_to_transform = Geometry([<curve referenced from the Rhino model> x187])
frame = Geometry(<curve referenced from the Rhino model>)
multiplication = Multiplication(A=animation_frame, B=Slider(0.05, range=0..0.1))
frame_2 = Geometry(frame)
dim = Dimensions(Surface=frame_2)  # -> UDimension, VDimension
handtrace = HandTrace(
    input_curve=geo_to_transform,
    deflectionlowerbound=Slider(0, range=0..1),
    deflectionupperbound=multiplication,
    lengthofdivision=Slider(0.528, range=0.2..3))
num = Number(animation_frame)
multiplication_2 = Multiplication(A=num, B=dim.UDimension)
X = UnitX(Factor=multiplication_2)
geo_3 = Geometry([frame_2, handtrace])
group = Group(Objects=flatten(geo_3))
move = Move(Geometry=group, Motion=X)  # -> Geometry, Transform
geo_4 = Geometry(move.Geometry)
bakeattributes = CSharpScript(objs=geo_4, layers=num, activate=bake_with_attributes, groupListTgthr=Toggle(True))  # -> out; inputs objs: list, names: list of String, layers: list of String, colors: list of Color, pWidths: list of Double, wiresEach: list of Int32, materials: list, activate: Boolean, groupListTgthr: Boolean
# ---------- bakeattributes: C# ----------
    //Inserts geometry into the Rhino document, with custom attributes
    //Written by Giulio Piacentino
    //Version written 2011 10 18 - for Grasshopper 0.8.52

    if (activate)
    {
      int groupIndex = -1;
      if(groupListTgthr)
        groupIndex = doc.Groups.Add();

      for(int i = 0; i < objs.Count; i++)
      {
        object obj = objs[i];
        if(obj == null)
        {
          Print("No object to bake");
          return;
        }

        //Make new attribute to set name
        Rhino.DocObjects.ObjectAttributes att = new Rhino.DocObjects.ObjectAttributes();

        string name = names.Count > 0 ? names[i % names.Count] : null;
        //Set object name
        if(!string.IsNullOrEmpty(name))
        {
          att.Name = name;
        }

        Color color = colors.Count > 0 ? colors[i % colors.Count] : new Color();
        //Set color
        if(!color.IsEmpty)
        {
          att.ColorSource = Rhino.DocObjects.ObjectColorSource.ColorFromObject; //Make the color type "by object"
          att.ObjectColor = color;

          att.PlotColorSource = Rhino.DocObjects.ObjectPlotColorSource.PlotColorFromObject; //Make the plot color type "by object"
          att.PlotColor = color;
        }

        string layer = layers.Count > 0 ? layers[i % layers.Count] : null;
        //Set layer
        if(!string.IsNullOrEmpty(layer) && Rhino.DocObjects.Layer.IsValidName(layer))
        {
          //Get the current layer index
          Rhino.DocObjects.Tables.LayerTable layerTable = doc.Layers;
          int layerIndex = layerTable.Find(layer, true);

          if(layerIndex < 0) //This layer does not exist, we add it
          {
            Rhino.DocObjects.Layer onlayer = new Rhino.DocObjects.Layer(); //Make a new layer
            onlayer.Name = layer;

            layerIndex = layerTable.Add(onlayer); //Add the layer to the layer table
            if (layerIndex > -1) //We manged to add layer!
            {
              att.LayerIndex = layerIndex;
              Print("Added new layer to the document at position " + layerIndex + " named " + layer + ". ");
            } else
              Print("Layer did not add. Try cleaning up your layers."); //This never happened to me.
          }
          else
            att.LayerIndex = layerIndex; //We simply add to the existing layer
        }


        double pWidth = pWidths.Count > 0 ? pWidths[i % pWidths.Count] : 0;
        //Set plotweight
        if(pWidth > 0)
        {
          att.PlotWeightSource = Rhino.DocObjects.ObjectPlotWeightSource.PlotWeightFromObject;
          att.PlotWeight = pWidth;
        }


        object material = materials.Count > 0 ? materials[i % materials.Count] : null;
        //Set material
        bool materialByName = !string.IsNullOrEmpty(material as string);
        Rhino.Display.DisplayMaterial inMaterial = material as Rhino.Display.DisplayMaterial;
        if(material is Color)
        {
          inMaterial = new Rhino.Display.DisplayMaterial((Color) material);
        }
        if(material != null && inMaterial == null && !materialByName)
        {
          if(!(material is string))
          {
            try //We also resort to try with IConvertible
            {
              inMaterial = (Rhino.Display.DisplayMaterial) Convert.ChangeType(material, typeof(Rhino.Display.DisplayMaterial));
            }
            catch(InvalidCastException)
            {
            }
          }
        }
        if(inMaterial != null || materialByName)
        {
          string matName;

          if(!materialByName)
          {
            matName = string.Format("A:{0}-D:{1}-E:{2}-S:{3},{4}-T:{5}",
              Format(inMaterial.Ambient),
              Format(inMaterial.Diffuse),
              Format(inMaterial.Emission),
              Format(inMaterial.Specular),
              inMaterial.Shine.ToString(),
              inMaterial.Transparency.ToString()
              );
          }
          else
          {
            matName = (string) material;
          }

          int materialIndex = doc.Materials.Find(matName, true);
          if(materialIndex < 0 && !materialByName) //Material does not exist and we have its specs
          {
            materialIndex = doc.Materials.Add(); //Let's add it
            if(materialIndex > -1)
            {
              Print("Added new material at position " + materialIndex + " named \"" + matName + "\". ");
              Rhino.DocObjects.Material m = doc.Materials[materialIndex];
              m.Name = matName;
              m.AmbientColor = inMaterial.Ambient;
              m.DiffuseColor = inMaterial.Diffuse;
              m.EmissionColor = inMaterial.Emission;
              //m.ReflectionColor = no equivalent
              m.SpecularColor = inMaterial.Specular;
              m.Shine = inMaterial.Shine;
              m.Transparency = inMaterial.Transparency;
              //m.TransparentColor = no equivalent
              m.CommitChanges();

              att.MaterialSource = Rhino.DocObjects.ObjectMaterialSource.MaterialFromObject;
              att.MaterialIndex = materialIndex;
            }
            else
              Print("Material did not add. Try cleaning up your materials."); //This never happened to me.
          }
          else if(materialIndex < 0 && materialByName) //Material does not exist and we do not have its specs. We do nothing
          {
            Print("Warning: material name not found. I cannot set the source to this material name. Add a material with name: " + matName);
          }
          else
          {
            //If this material exists, we do not replace it!
            att.MaterialSource = Rhino.DocObjects.ObjectMaterialSource.MaterialFromObject;
            att.MaterialIndex = materialIndex;
          }
        }


        int wires = wiresEach.Count > 0 ? wiresEach[i % wiresEach.Count] : 0;
        //Set wire density
        if(wires == -1 || wires > 0)
        {
          att.WireDensity = wires;
        }

        Bake(obj, att, groupIndex);
      }
    }
    else
    {
      Print("Inactive");
    }
# ---------- bakeattributes: C# additional code ----------
  void Bake(object obj, Rhino.DocObjects.ObjectAttributes att, int groupIndex)
  {
    if(obj == null)
      return;

    Guid id;

    //Bake to the right type of object
    if(obj is GeometryBase)
    {
      GeometryBase geomObj = obj as GeometryBase;

      switch(geomObj.ObjectType)
      {
        case Rhino.DocObjects.ObjectType.Brep:
          id = doc.Objects.AddBrep(obj as Brep, att);
          break;
        case Rhino.DocObjects.ObjectType.Curve:
          id = doc.Objects.AddCurve(obj as Curve, att);
          break;
        case Rhino.DocObjects.ObjectType.Point:
          id = doc.Objects.AddPoint((obj as Rhino.Geometry.Point).Location, att);
          break;
        case Rhino.DocObjects.ObjectType.Surface:
          id = doc.Objects.AddSurface(obj as Surface, att);
          break;
        case Rhino.DocObjects.ObjectType.Mesh:
          id = doc.Objects.AddMesh(obj as Mesh, att);
          break;
        case (Rhino.DocObjects.ObjectType) 1073741824://Rhino.DocObjects.ObjectType.Extrusion:
          id = (Guid) typeof(Rhino.DocObjects.Tables.ObjectTable).InvokeMember("AddExtrusion", BindingFlags.Instance | BindingFlags.InvokeMethod, null, doc.Objects, new object[]{obj, att});
          break;
        case Rhino.DocObjects.ObjectType.PointSet:
          id = doc.Objects.AddPointCloud(obj as Rhino.Geometry.PointCloud, att); //This is a speculative entry
          break;
        default:
          Print("The script does not know how to handle this type of geometry: " + obj.GetType().FullName);
          return;
      }
    }
    else
    {
      Type objectType = obj.GetType();

      if(objectType == typeof(Arc))
      {
        id = doc.Objects.AddArc((Arc) obj, att);
      }
      else if(objectType == typeof(Box))
      {
        id = doc.Objects.AddBrep(((Box) obj).ToBrep(), att);
      }
      else if(objectType == typeof(Circle))
      {
        id = doc.Objects.AddCircle((Circle) obj, att);
      }
      else if(objectType == typeof(Ellipse))
      {
        id = doc.Objects.AddEllipse((Ellipse) obj, att);
      }
      else if(objectType == typeof(Polyline))
      {
        id = doc.Objects.AddPolyline((Polyline) obj, att);
      }
      else if(objectType == typeof(Sphere))
      {
        id = doc.Objects.AddSphere((Sphere) obj, att);
      }
      else if(objectType == typeof(Point3d))
      {
        id = doc.Objects.AddPoint((Point3d) obj, att);
      }
      else if(objectType == typeof(Line))
      {
        id = doc.Objects.AddLine((Line) obj, att);
      }
      else if(objectType == typeof(Vector3d))
      {
        Print("Impossible to bake vectors");
        return;
      }
      else if(obj is IEnumerable)
      {
        int newGroupIndex;
        if(groupIndex == -1)
          newGroupIndex = doc.Groups.Add();
        else
          newGroupIndex = groupIndex;
        foreach(object o in obj as IEnumerable)
        {
          Bake(o, att, newGroupIndex);
        }
        return;
      }
      else
      {
        Print("Unhandled type: " + objectType.FullName);
        return;
      }
    }

    if(groupIndex != -1)
    {
      doc.Groups.AddToGroup(groupIndex, id);
      Print("Added " + obj.GetType().Name + " to group number " + groupIndex);
    }
    else
      Print("Added " + obj.GetType().Name);
  }

  static string Format(Color c)
  {
    return (new System.Text.StringBuilder("A")).Append(c.A.ToString()).Append("R").Append(c.R.ToString()).Append("G")
      .Append(c.G.ToString()).Append("B").Append(c.B.ToString()).ToString();
  }
# ---------- end bakeattributes ----------
panel = Panel(bakeattributes)

geo_5 = Geometry([<curve referenced from the Rhino model> x186])
handtrace_2 = HandTrace(
    input_curve=geo_5,
    deflectionlowerbound=Slider(0.1, range=0..1),
    deflectionupperbound=Slider(0.2, range=0..1),
    lengthofdivision=Slider(0.5, range=0.2..3))
geo_6 = Geometry(handtrace_2)

geo_7 = Geometry([<curve referenced from the Rhino model> x187])
fuzzmaker = FuzzMaker(
    geo=geo_7,
    numberofdivisions=Slider(0.3, range=0..8),
    lengthofline=Slider(0.292, range=0..10),
    angle=Slider(89, range=0..100))
geo_8 = Geometry(fuzzmaker)

geo_9 = Geometry([<curve referenced from the Rhino model> x187])
X_2 = UnitX(Factor=1)
Y = UnitY(Factor=1)
richterify = Richterify(
    inputlne=geo_9,
    divisionlengths=Slider(0.5, range=0.1..2),
    comparisonvector=Y,
    amplification_factor=Slider(0.9, range=0..10))
geo_10 = Geometry(richterify)

geo_11 = Geometry()
circlesalongline = CirclesAlongLine(inputline=geo_11, numberofdivisions=Slider(5, range=0..100), radius=Slider(0.2, range=0..11))
geo_12 = Geometry(circlesalongline)

animation_frame_2 = Slider(6, range=0..30)
x_divisions = Slider(4, range=0..10)
y_divisions = Slider(7, range=0..10)
geo_to_slice = Geometry([<curve referenced from the Rhino model> x187])
new_frame_point = Point(<point referenced from the Rhino model>)
# Brakhage-Izer
frame_3 = Geometry(<curve referenced from the Rhino model>)

# ----
# Cluster Examples
geo_13 = Geometry([<curve referenced from the Rhino model> x187])
linetracer = LineTracer(
    input_curve=geo_13,
    deflectionlowerbound=Slider(-0.2, range=-1..1),
    deflectionupperbound=Slider(0.284, range=0..1),
    lengthofdivision=Slider(0.729, range=0.1..3))
geo_14 = Geometry(flatten(linetracer))

num_2 = Number(graft(animation_frame_2))
framedimensions = FrameDimensions(C=frame_3)  # -> num_4, num_3, pt_2
animation_frame_3 = Number(num_2)
x_divisions_2 = Number(x_divisions)
y_divisions_2 = Number(y_divisions)
division = Division(A=framedimensions.num_3, B=y_divisions_2)
division_2 = Division(A=framedimensions.num_4, B=x_divisions_2)
mod = Modulus(A=animation_frame_3, B=x_divisions_2)
integer_division = IntegerDivision(A=animation_frame_3, B=x_divisions_2)
xy = XYPlane(Origin=framedimensions.pt_2)
new_x_dimensions = Number(division_2)
new_y_dimensions = Number(division)
x_coords = Number(mod)
y_coords = Number(integer_division)
_1 = Number(1)
multiplication_3 = Multiplication(A=new_y_dimensions, B=y_coords)
multiplication_4 = Multiplication(A=new_x_dimensions, B=x_coords)
division_3 = Division(A=_1, B=x_divisions_2)
division_4 = Division(A=_1, B=y_divisions_2)
neg = Negative(Value=multiplication_3)
scale_nu = ScaleNU(Geometry=frame_3, Plane=xy, ScaleX=division_3, ScaleY=division_4, ScaleZ=1)  # -> Geometry, Transform
vec = VectorXYZ(XComponent=multiplication_4, YComponent=neg, ZComponent=Slider(0, range=0..100))  # -> Vector, Length
move_2 = Move(Geometry=scale_nu.Geometry, Motion=vec.Vector)  # -> Geometry, Transform
frame_slice = Geometry(move_2.Geometry)
trim = TrimWithRegion(Curve=geo_to_slice, Region=graft(frame_slice))  # -> Inside, Outside
framedimensions_2 = FrameDimensions(C=frame_slice)  # -> num_4, num_3, pt_2
sliced_geo = Geometry(trim.Inside)
vec2pt = Vector2Pt(PointA=framedimensions_2.pt_2, PointB=new_frame_point, Unitize=False)  # -> Vector, Length
move_3 = Move(Geometry=[sliced_geo, frame_slice], Motion=vec2pt.Vector)  # -> Geometry, Transform
geo_15 = Geometry(flatten(move_3.Geometry))
group_2 = Group(Objects=geo_15)  # -> flatten(Group)
bakeattributes_2 = CSharpScript(objs=group_2, layers=num_2, activate=Toggle(False), groupListTgthr=Toggle(True))  # -> out; inputs objs: list, names: list of String, layers: list of String, colors: list of Color, pWidths: list of Double, wiresEach: list of Int32, materials: list, activate: Boolean, groupListTgthr: Boolean; same code as bakeattributes
panel_2 = Panel(bakeattributes_2)

# ==== cluster CirclesAlongLine
numberofdivisions = ClusterInput()
inputline = ClusterInput()
radius = ClusterInput()
radius_2 = Data(radius)
numberofdivisions_2 = Data(numberofdivisions)
inputline_2 = Data(inputline)
divide = DivideCurve(Curve=inputline_2, Count=numberofdivisions_2, Kinks=False)  # -> Points, Tangents, Parameters
cir = Circle(Plane=divide.Points, Radius=radius_2)
outputcircles = Data(cir)
outputcircles_2 = ClusterOutput(outputcircles)

# ==== cluster HandTrace
input_curve = ClusterInput()
deflectionlowerbound = ClusterInput()
deflectionupperbound = ClusterInput()
lengthofdivision = ClusterInput()
input_curve_2 = Data(graft(input_curve))
deflectionlowerbound_2 = Number(deflectionlowerbound)
lengthofdivision_2 = Data(lengthofdivision)
deflectionupperbound_2 = Number(deflectionupperbound)
linetracer = LineTracer(
    input_curve=input_curve_2,
    deflectionlowerbound=deflectionlowerbound_2,
    deflectionupperbound=deflectionupperbound_2,
    lengthofdivision=lengthofdivision_2)
linetracer_2 = LineTracer(
    input_curve=input_curve_2,
    deflectionlowerbound=deflectionlowerbound_2,
    deflectionupperbound=deflectionupperbound_2,
    lengthofdivision=lengthofdivision_2)
mirror = MirrorCurve(Geometry=linetracer, Curve=input_curve_2, Tangent=True)
linetracer_3 = LineTracer(
    input_curve=input_curve_2,
    deflectionlowerbound=deflectionlowerbound_2,
    deflectionupperbound=deflectionupperbound_2,
    lengthofdivision=lengthofdivision_2)
linetracer_4 = LineTracer(
    input_curve=input_curve_2,
    deflectionlowerbound=deflectionlowerbound_2,
    deflectionupperbound=deflectionupperbound_2,
    lengthofdivision=lengthofdivision_2)
mirror_2 = MirrorCurve(Geometry=linetracer_3, Curve=mirror, Tangent=True)
geo = Geometry([mirror_2, mirror, linetracer_2, linetracer_4])
geo_2 = ClusterOutput(geo)

# ==== cluster LineHatcher
inputline = ClusterInput()
divisionlengths = ClusterInput()
divisionlengths_2 = Data(divisionlengths)
inputline_2 = Data(inputline)
divlength = DivideLength(Curve=inputline_2, Length=divisionlengths_2)  # -> Points, Tangents, Parameters
lineangle = ClusterInput()
Z = UnitZ(Factor=1)
linelength = ClusterInput()
lineangle_2 = Data(lineangle)
linelength_2 = Data(linelength)
rad = Radians(Degrees=lineangle_2)
vrot = Rotate(Vector=divlength.Tangents, Axis=Z, Angle=rad)
amp = Amplitude(Vector=vrot, Amplitude=linelength_2)
rev = Reverse(Vector=amp)
move = Move(Geometry=divlength.Points, Motion=amp)  # -> Geometry, Transform
move_2 = Move(Geometry=divlength.Points, Motion=rev)  # -> Geometry, Transform
ln = Line(StartPoint=move.Geometry, EndPoint=move_2.Geometry)
L = ClusterOutput(ln)

# ==== cluster FrameDimensions
C = ClusterInput()
cp = ControlPoints(Curve=C)  # -> Points, Weights, Knots
pcomp = Decompose(Point=cp.Points, System=PlaneXY(0, 0, 0))  # -> XComponent, YComponent, ZComponent
bnd = Bounds(Numbers=pcomp.XComponent)
bnd_2 = Bounds(Numbers=pcomp.YComponent)
domcomp = DomainComponents(Domain=bnd)  # -> Start, End
domcomp_2 = DomainComponents(Domain=bnd_2)  # -> Start, End
num = Number(bnd)
num_2 = Number(bnd_2)
num_3 = ClusterOutput(num_2)
num_4 = ClusterOutput(num)
pt = PointXYZ(XComponent=domcomp.Start, YComponent=domcomp_2.End, ZComponent=0, System=PlaneXY(0, 0, 0))
pt_2 = ClusterOutput(pt)

# ==== cluster Richterify
comparisonvector = ClusterInput()
divisionlengths = ClusterInput()
inputlne = ClusterInput()
inputlne_2 = Data(inputlne)
comparisonvector_2 = Data(comparisonvector)
divisionlengths_2 = Data(divisionlengths)
amplification_factor = ClusterInput()
divlength = DivideLength(Curve=inputlne_2, Length=divisionlengths_2)  # -> Points, Tangents, Parameters
amplification_factor_2 = Data(amplification_factor)
xprod = CrossProduct(VectorA=divlength.Tangents, VectorB=comparisonvector_2, Unitize=False)  # -> Vector, Length
multiplication = Multiplication(A=xprod.Vector, B=amplification_factor_2)
X = UnitX(Factor=multiplication)
rev = Reverse(Vector=X)
move = Move(Geometry=divlength.Points, Motion=X)  # -> Geometry, Transform
move_2 = Move(Geometry=divlength.Points, Motion=rev)  # -> Geometry, Transform
ln = Line(StartPoint=move.Geometry, EndPoint=move_2.Geometry)
L = ClusterOutput(ln)

# ==== cluster FuzzMaker
lengthofline = ClusterInput()
geo = ClusterInput()
numberofdivisions = ClusterInput()
angle = ClusterInput()
geo_2 = Geometry(graft(geo))
angle_2 = Data(angle)
lengthofline_2 = Data(lengthofline)
numberofdivisions_2 = Data(numberofdivisions)
divlength = DivideLength(Curve=geo_2, Length=numberofdivisions_2)  # -> Points, Tangents, Parameters
line = LineSDL(Start=divlength.Points, Direction=divlength.Tangents, Length=lengthofline_2)
xy = XYPlane(Origin=divlength.Points)
rad = Radians(Degrees=angle_2)
rotate = Rotate(Geometry=line, Angle=rad, Plane=xy)  # -> Geometry, Transform
mirror = MirrorCurve(Geometry=rotate.Geometry, Curve=geo_2, Tangent=True)
geo_3 = Geometry([mirror, rotate.Geometry])
geo_4 = ClusterOutput(geo_3)

# ==== cluster LineTracer
input_curve = ClusterInput()
lengthofdivision = ClusterInput()
deflectionupperbound = ClusterInput()
deflectionlowerbound = ClusterInput()
input_curve_2 = Data(input_curve)
lengthofdivision_2 = Data(lengthofdivision)
deflectionlowerbound_2 = Number(deflectionlowerbound)
deflectionupperbound_2 = Number(deflectionupperbound)
divlength = DivideLength(Curve=input_curve_2, Length=lengthofdivision_2)  # -> Points, Tangents, Parameters
ma = MassAddition(Input=divlength.Points)  # -> Result, PartialResults
Z = UnitZ(Factor=1)
multiplication = Multiplication(A=deflectionlowerbound_2, B=deflectionupperbound_2)
dom = Domain(DomainStart=deflectionlowerbound_2, DomainEnd=deflectionupperbound_2)
lng = ListLength(List=divlength.Points)
rad = Radians(Degrees=Slider(90, range=0..100))
vrot = Rotate(Vector=divlength.Tangents, Axis=Z, Angle=rad)
multiplication_2 = Multiplication(A=multiplication, B=Slider(1000, range=0..1000))
multiplication_3 = Multiplication(A=multiplication_2, B=ma.Result)
random = Random(Range=dom, Number=lng, Seed=multiplication_3)
amp = Amplitude(Vector=vrot, Amplitude=random)
move = Move(Geometry=divlength.Points, Motion=amp)  # -> Geometry, Transform
intcrv = Interpolate(Vertices=move.Geometry, Degree=3, Periodic=False, KnotStyle=1)  # -> Curve, Length, Domain
C = ClusterOutput(intcrv.Curve)
