# Grasshopper definition Axon and Oblique-199217.gh (Grasshopper 0.9.14)

pipeline = GeometryPipeline(
    LayerFilter="3D Geometry",
    NameFilter="*",
    TypeFilter=24,
    IncludeLocked=True,
    IncludeHidden=True,
    GroupByLayer=False,
    GroupByType=False)
yz = YZPlane(Origin=Point(0, 0, 0))
xz = XZPlane(Origin=Point(0, 0, 0))
xy = XYPlane(Origin=Point(0, 0, 0))

# ---- group: Inputs
brep_building_for_axon = Brep(pipeline)
pt_drawing_location = Point(<point referenced from the Rhino model>)

# ----
pt_label_point = Point(<point referenced from the Rhino model>)
pln = Plane(xy)
swatch = ColourSwatch(SwatchColor=RGB(0, 0, 0))
swatch_2 = ColourSwatch(SwatchColor=RGB(0, 0, 0))

# ---- group: Variables
x_proportion = Slider(1, range=0..1.5)
angle_1 = Slider(125, range=-180..180)
y_proportion = Slider(1, range=0..1.5)
z_proportion = Slider(1, range=0..1.5)
angle_2 = Slider(90, range=0..180)

# ---- group: Creates Axonometric / Oblique Coordinate System
cluster = Cluster_3(pt_drawing_location=pt_drawing_location, num_angle_1=angle_1, num_angle_2=angle_2)  # -> crv_new_coordinate_system_01_6, crv_new_coordinate_system_01_5, crv_new_coordinate_system_01_4, num_angle_3_2

# ---- group: Variables (continued)
angle_3 = Panel(cluster.num_angle_3_2)

# ---- group: Translates Coordinates from 3D to 2D
cluster_2 = Cluster_4(
    brep_building_for_axon=brep_building_for_axon,
    pln_reference_plane=pln,
    pt_drawing_location=pt_drawing_location,
    crv_2d_x_direction=cluster.crv_new_coordinate_system_01_5,
    crv_2d_y_direction=cluster.crv_new_coordinate_system_01_4)  # -> num_z_value_2, num_x_value_2, num_y_value_2, crv_2d_x_2, crv_3d_y_2

# ---- group: Labels Reference Angles
cluster_3 = Cluster(
    crv_new_coordinate_system_01_2=cluster.crv_new_coordinate_system_01_6,
    crv_new_coordinate_system_01_3=cluster.crv_new_coordinate_system_01_5,
    crv_new_coordinate_system_01=cluster.crv_new_coordinate_system_01_4)  # -> crv_angle_lines_2, pln_angle_1_location_2, pln_angle_2_location_2, pln_angle_3_location_2

# ---- group: Conditional Statements for Drawing Labeling
cluster_4 = Cluster_2(
    num_angle_1=angle_1,
    num_angle_2=angle_2,
    num_angle_3=angle_3,
    pt_label_point=pt_label_point,
    num_y_proportion=y_proportion,
    num_z_proportion=z_proportion,
    num_x_proportion=x_proportion)  # -> str_axonometric_2, second_point, str_oblique_2, point_2, str_3_2

# ----
num_angle_1 = Number(angle_1)
num_angle_3 = Number(cluster.num_angle_3_2)
num_angle_2 = Number(angle_2)

# ---- group: Changes Proportion
multiplication = Multiplication(A=x_proportion, B=cluster_2.num_x_value_2)
multiplication_2 = Multiplication(A=y_proportion, B=cluster_2.num_y_value_2)
multiplication_3 = Multiplication(A=z_proportion, B=cluster_2.num_z_value_2)

# ---- group: Creates the Drawing
cluster_5 = Cluster_5(
    crv_new_x=cluster_2.crv_2d_x_2,
    num_x_value=multiplication,
    num_y_value=multiplication_2,
    crv_new_y=cluster_2.crv_3d_y_2,
    num_z_value=multiplication_3)  # -> mesh_6, mesh_5, crv_axon_drawing_2, mesh_2

# ----
int = Integer([num_angle_1, num_angle_2, num_angle_3])
tag = TextTag3D(Location=pt_label_point, Text=cluster_4.str_axonometric_2, Size=1, Colour=swatch)
tag_2 = TextTag3D(Location=cluster_4.second_point, Text=cluster_4.str_oblique_2, Size=1, Colour=swatch)
tag_3 = TextTag3D(Location=cluster_4.point_2, Text=cluster_4.str_3_2, Size=1, Colour=swatch)
tag_4 = TextTag3D(
    Location=[cluster_3.pln_angle_1_location_2, cluster_3.pln_angle_2_location_2, cluster_3.pln_angle_3_location_2],
    Text=int,
    Size=0.75,
    Colour=swatch_2)
preview = CustomPreview(Geometry=cluster_3.crv_angle_lines_2, Shader=swatch_2)
preview_2 = CustomPreview(Geometry=cluster_5.mesh_6, Shader=ColourSwatch(SwatchColor=RGBA(0, 0, 0, 215)))
preview_3 = CustomPreview(Geometry=[cluster_5.crv_axon_drawing_2, cluster_5.mesh_2], Shader=ColourSwatch(SwatchColor=RGB(0, 0, 0)))
preview_4 = CustomPreview(Geometry=cluster_5.mesh_5, Shader=ColourSwatch(SwatchColor=RGBA(0, 0, 0, 140)))

# ==== cluster Cluster
crv_new_coordinate_system_01 = ClusterInput()
crv_new_coordinate_system_01_2 = ClusterInput()
crv_new_coordinate_system_01_3 = ClusterInput()
crv_new_coordinate_system_01_4 = Curve(crv_new_coordinate_system_01)
crv_new_coordinate_system_01_5 = Curve(crv_new_coordinate_system_01_2)
crv_new_coordinate_system_01_6 = Curve(crv_new_coordinate_system_01_3)
Y = UnitY(Factor=-3)
move = Move(Geometry=crv_new_coordinate_system_01_5, Motion=Y)  # -> Geometry, Transform
move_2 = Move(Geometry=crv_new_coordinate_system_01_6, Motion=Y)  # -> Geometry, Transform
move_3 = Move(Geometry=crv_new_coordinate_system_01_4, Motion=Y)  # -> Geometry, Transform
curvepoint = PointOnCurve(move_3.Geometry, parameter=0.75)
curvepoint_2 = PointOnCurve(move_2.Geometry, parameter=0.75)
ln = Line(StartPoint=curvepoint_2, EndPoint=curvepoint)
curvepoint_3 = PointOnCurve(ln, parameter=0.9)
curvepoint_4 = PointOnCurve(move.Geometry, parameter=0.75)
ln_2 = Line(StartPoint=curvepoint_4, EndPoint=curvepoint)
curvepoint_5 = PointOnCurve(ln_2, parameter=0.5)
ln_3 = Line(StartPoint=curvepoint_4, EndPoint=curvepoint_2)
curvepoint_6 = PointOnCurve(ln_3, parameter=0.5)
end = EndPoints(Curve=move_3.Geometry)  # -> Start, End
end_2 = EndPoints(Curve=move_3.Geometry)  # -> Start, End
end_3 = EndPoints(Curve=move_3.Geometry)  # -> Start, End
ln_4 = Line(StartPoint=end.Start, EndPoint=curvepoint_3)
ln_5 = Line(StartPoint=end_2.Start, EndPoint=curvepoint_6)
ln_6 = Line(StartPoint=end_3.Start, EndPoint=curvepoint_5)
line = LineSDL(Start=end.Start, Direction=ln_4, Length=1.25)
line_2 = LineSDL(Start=end_2.Start, Direction=ln_5, Length="1")
line_3 = LineSDL(Start=end_3.Start, Direction=ln_6, Length=2.25)
end_4 = EndPoints(Curve=line)  # -> Start, End
end_5 = EndPoints(Curve=line_2)  # -> Start, End
end_6 = EndPoints(Curve=line_3)  # -> Start, End
panel = Panel(""".3
.15""")

# ---- group: Angle 1
xy = XYPlane(Origin=end_4.End)

xy_2 = XYPlane(Origin=end_5.End)

xy_3 = XYPlane(Origin=end_6.End)

# ----
dash = DashPattern(Curve=move.Geometry, Pattern=panel)  # -> Dashes, Gaps
dash_2 = DashPattern(Curve=move_2.Geometry, Pattern=panel)  # -> Dashes, Gaps
dash_3 = DashPattern(Curve=move_3.Geometry, Pattern=panel)  # -> Dashes, Gaps
pln_angle_2_location = Plane(xy)
pln_angle_1_location = Plane(xy_2)
pln_angle_3_location = Plane(xy_3)
crv_angle_lines = Curve([dash.Dashes, dash_2.Dashes, dash_3.Dashes])
pln_angle_2_location_2 = ClusterOutput(pln_angle_2_location)
pln_angle_1_location_2 = ClusterOutput(pln_angle_1_location)
pln_angle_3_location_2 = ClusterOutput(pln_angle_3_location)
crv_angle_lines_2 = ClusterOutput(crv_angle_lines)

# ==== cluster Cluster_2
num_z_proportion = ClusterInput()
num_y_proportion = ClusterInput()
num_x_proportion = ClusterInput()
num_angle_2 = ClusterInput()
num_angle_1 = ClusterInput()
num_angle_3 = ClusterInput()
num_y_proportion_2 = Number(num_y_proportion)
num_z_proportion_2 = Number(num_z_proportion)
num_x_proportion_2 = Number(num_x_proportion)
pt_label_point = ClusterInput()
num_angle_2_2 = Number(num_angle_2)
num_angle_1_2 = Number(num_angle_1)
num_angle_3_2 = Number(num_angle_3)
pt_label_point_2 = Point(pt_label_point)
equals = Equality(FirstNumber=num_angle_3_2, SecondNumber=90)  # -> Equality, Inequality
equals_2 = Equality(FirstNumber=num_angle_1_2, SecondNumber=90)  # -> Equality, Inequality
equals_3 = Equality(FirstNumber=num_angle_2_2, SecondNumber=90)  # -> Equality, Inequality
equals_4 = Equality(FirstNumber=num_z_proportion_2, SecondNumber=0.5)  # -> Equality, Inequality
equals_5 = Equality(FirstNumber=[num_y_proportion_2, num_z_proportion_2, num_x_proportion_2], SecondNumber=1)  # -> Equality, Inequality
equals_6 = Equality(FirstNumber=[num_y_proportion_2, num_x_proportion_2], SecondNumber=0.5)  # -> Equality, Inequality
equals_7 = Equality(FirstNumber=[num_y_proportion_2, num_x_proportion_2], SecondNumber=0.75)  # -> Equality, Inequality
ma = MassAddition(Input=[equals_2.Equality, equals_3.Equality, equals.Equality])  # -> Result, PartialResults
equals_8 = Equality(FirstNumber=num_angle_1_2, SecondNumber=num_angle_2_2)  # -> Equality, Inequality
ma_2 = MassAddition(Input=equals_6.Equality)  # -> Result, PartialResults
equals_9 = Equality(FirstNumber=num_angle_1_2, SecondNumber=num_angle_3_2)  # -> Equality, Inequality
ma_3 = MassAddition(Input=equals_7.Equality)  # -> Result, PartialResults
equals_10 = Equality(FirstNumber=num_angle_2_2, SecondNumber=num_angle_3_2)  # -> Equality, Inequality
ma_4 = MassAddition(Input=equals_5.Equality)  # -> Result, PartialResults
ma_5 = MassAddition(Input=[equals.Equality, equals_2.Equality])  # -> Result, PartialResults
xy = XYPlane(Origin=pt_label_point_2)
vb = VBScript(x=ma_4.Result)  # -> out, A
# ---------- vb: VB ----------
    If x = 3 Then
      a = True
    Else a = False
    End If
# ---------- end vb ----------
ma_6 = MassAddition(Input=[equals_8.Equality, equals_10.Equality, equals_9.Equality])  # -> Result, PartialResults
vb_2 = VBScript(x=ma_6.Result)  # -> out, A
# ---------- vb_2: VB ----------
    If x = 0 Then
      a = "Trimetric"
    Else If x = 1 Then
      a = "Dimetric"
    Else If x = 3 Then
      a = "Isometric"
    End If
# ---------- end vb_2 ----------
Y = UnitY(Factor=-1.45)
dispatch = Dispatch(List="Elevation ", DispatchPattern=ma_5.Result)  # -> ListA, ListB
dispatch_2 = Dispatch(List="Plan ", DispatchPattern=equals_3.Equality)  # -> ListA, ListB
move = Move(Geometry=xy, Motion=Y)  # -> SecondPoint, Transform
str_axonometric = String(vb_2.A)
move_2 = Move(Geometry=move.SecondPoint, Motion=Y)  # -> SecondPoint, Transform
dispatch_3 = Dispatch(List="General", DispatchPattern=ma_3.Result)  # -> ListA, ListB
dispatch_4 = Dispatch(List="Cabinet", DispatchPattern=ma_2.Result)  # -> ListA, ListB
dispatch_5 = Dispatch(List="Millitary Perspective", DispatchPattern=equals_4.Equality)  # -> ListA, ListB
second_point = ClusterOutput(move.SecondPoint)
concat = Concatenate(A=dispatch.ListA, B=dispatch_2.ListA)
concat_2 = Concatenate(A=concat, B="Oblique")
dispatch_6 = Dispatch(List=concat_2, DispatchPattern=ma.Result)  # -> ListA, ListB
dispatch_7 = Dispatch(List="Cavalier", DispatchPattern=vb.A)  # -> ListA, ListB
str_oblique = String(dispatch_6.ListA)
str_axonometric_2 = ClusterOutput(str_axonometric)
point = Point(move_2.SecondPoint)
concat_3 = Concatenate(A=dispatch_3.ListA, B=dispatch_4.ListA)
concat_4 = Concatenate(A=concat_3, B=dispatch_5.ListA)
dispatch_8 = Dispatch(List=concat_4, DispatchPattern=vb.A)  # -> ListA, ListB
str_oblique_2 = ClusterOutput(str_oblique)
point_2 = ClusterOutput(point)
str_3 = String([dispatch_7.ListA, dispatch_8.ListB])
str_3_2 = ClusterOutput(str_3)

# ==== cluster Cluster_3
num_angle_1 = ClusterInput()
num_angle_2 = ClusterInput()
pt_drawing_location = ClusterInput()
num_angle_1_2 = Number(num_angle_1)
num_angle_2_2 = Number(num_angle_2)
pt_drawing_location_2 = Point(pt_drawing_location)
rad = Radians(Degrees=num_angle_2_2)
rad_2 = Radians(Degrees=num_angle_1_2)
abs = Absolute(Value=num_angle_1_2)
abs_2 = Absolute(Value=num_angle_2_2)
Y = UnitY(Factor=1)
addition = Addition(A=abs, B=abs_2)
xy = XYPlane(Origin=pt_drawing_location_2)
line = LineSDL(Start=pt_drawing_location_2, Direction=Y, Length=-2)
subtraction = Subtraction(A=360, B=addition)
rotate = Rotate(Geometry=line, Angle=rad_2, Plane=xy)  # -> Geometry, Transform
rotate_2 = Rotate(Geometry=rotate.Geometry, Angle=rad, Plane=xy)  # -> Geometry, Transform
num_angle_3 = Number(subtraction)
crv_new_coordinate_system_01 = Curve(rotate_2.Geometry)
crv_new_coordinate_system_01_2 = Curve(rotate.Geometry)
crv_new_coordinate_system_01_3 = Curve(line)
num_angle_3_2 = ClusterOutput(num_angle_3)
crv_new_coordinate_system_01_4 = ClusterOutput(crv_new_coordinate_system_01)
crv_new_coordinate_system_01_5 = ClusterOutput(crv_new_coordinate_system_01_2)
crv_new_coordinate_system_01_6 = ClusterOutput(crv_new_coordinate_system_01_3)

# ==== cluster Cluster_4
brep_building_for_axon = ClusterInput()
brep_building_for_axon_2 = Brep(brep_building_for_axon)
pln_reference_plane = ClusterInput()
pt_drawing_location = ClusterInput()
crv_2d_x_direction = ClusterInput()
crv_2d_y_direction = ClusterInput()
sunion = SolidUnion(Breps=brep_building_for_axon_2)  # -> flatten(Result)
fmerge = MergeFaces(Brep=sunion)  # -> Breps, Before, After
pln_reference_plane_2 = Plane(pln_reference_plane)
pt_drawing_location_2 = Point(pt_drawing_location)
crv_2d_x_direction_2 = Curve(crv_2d_x_direction)
crv_2d_y_direction_2 = Curve(crv_2d_y_direction)
explode = BrepComponents(Brep=fmerge.Breps)  # -> Faces, Edges, Vertices
bbox = BoundingBox(Content=sunion, Plane=pln_reference_plane_2, UnionBox=True)  # -> Box, Box_2
explode_2 = BrepComponents(Brep=explode.Faces)  # -> Faces, Edges, Vertices
preview = CustomPreview(Geometry=sunion, Shader=ColourSwatch(SwatchColor=RGBA(235, 235, 235, 94)))
panel = Panel(""".3
.1""")
explode_3 = Explode(Curve=explode_2.Edges, Recursive=True)  # -> Segments, Vertices
explode_4 = BrepComponents(Brep=bbox.Box)  # -> Faces, Edges, Vertices
swatch = ColourSwatch(SwatchColor=RGB(0, 0, 0))
item = ListItem(List=explode_4.Vertices, Index=0, Wrap=False)
item_2 = ListItem(List=explode_4.Edges, Index=0, Wrap=False)
item_3 = ListItem(List=explode_4.Edges, Index=3, Wrap=False)
offset = Offset(Curve=[item_2, item_3], Distance=-0.05, Plane=PlaneXY(0, 0, 0), Corners=1)
offset_2 = Offset(Curve=[item_2, item_3], Distance=0.05, Plane=PlaneXY(0, 0, 0), Corners=1)
loft = Loft(
    Curves=[offset_2, offset],
    Options={Adjust=False, Closed=False, Rebuild=10, Refit=0.01, LoftType=0, LoftEnds=0, LoftSimp=0})
pt_reference_point = Point(item)

# ---- group: X Length
len = Length(Curve=item_2)

# ---- group: Y Length
len_2 = Length(Curve=item_3)

# ----
preview_2 = CustomPreview(Geometry=loft, Shader=swatch)

# ---- group: New X
line = LineSDL(Start=pt_drawing_location_2, Direction=crv_2d_x_direction_2, Length=len)

# ---- group: New Y
line_2 = LineSDL(Start=pt_drawing_location_2, Direction=crv_2d_y_direction_2, Length=len_2)

# ----
pl = Plane(Origin=pt_reference_point, XAxis=item_2, YAxis=item_3)
crv_2d_x = Curve(line)
crv_3d_y = Curve(line_2)
pln_orientation_plane = Plane(pl)
pln_orientation_plane_2 = Plane(pln_orientation_plane)
pcomp = PlaneComponents(Plane=pln_orientation_plane_2)  # -> Origin, XAxis, YAxis, ZAxis
crv_2d_x_2 = ClusterOutput(crv_2d_x)
crv_3d_y_2 = ClusterOutput(crv_3d_y)

# ---- group: Step 1 - Z coordinates
project = Project(Geometry=explode_3.Vertices, Plane=pln_orientation_plane_2)  # -> Geometry, Transform
pt = Point(explode_3.Vertices)

# ----
ln = Line(StartPoint=pt, EndPoint=project.Geometry)
dash = DashPattern(Curve=ln, Pattern=panel)  # -> Dashes, Gaps
dist = Distance(PointA=explode_3.Vertices, PointB=project.Geometry)  # -> graft(Distance)
line_3 = LineSDL(Start=project.Geometry, Direction=pcomp.XAxis, Length=-30)
line_4 = LineSDL(Start=project.Geometry, Direction=pcomp.YAxis, Length=30)
dash_2 = DashPattern(Curve=[line_3, line_4], Pattern=panel)  # -> Dashes, Gaps
num_z_value = Number(dist)
num_z_value_2 = ClusterOutput(num_z_value)

# ---- group: Step 1 - Z coordinates (continued)
vdis = VectorDisplay(Anchor=pt, Vector=ln)

# ---- group: Step 2 - X,Y Coordinates
ccx = CurveCurve(CurveA=line_4, CurveB=item_2)  # -> Points, ParamsA, ParamsB
ccx_2 = CurveCurve(CurveA=line_3, CurveB=item_3)  # -> Points, ParamsA, ParamsB
preview_3 = CustomPreview(Geometry=dash_2.Dashes, Shader=swatch)

# ----
dist_2 = Distance(PointA=graft(project.Geometry), PointB=ccx_2.Points)
dist_3 = Distance(PointA=graft(project.Geometry), PointB=ccx.Points)
num_y_value = Number(dist_3)
num_x_value = Number(dist_2)
num_y_value_2 = ClusterOutput(num_y_value)
num_x_value_2 = ClusterOutput(num_x_value)
ln_2 = Line(StartPoint=graft(project.Geometry), EndPoint=ccx_2.Points)
ln_3 = Line(StartPoint=graft(project.Geometry), EndPoint=ccx.Points)

# ---- group: Step 2 - X,Y Coordinates (continued)
vdis_2 = VectorDisplay(Anchor=graft(project.Geometry), Vector=ln_3)
vdis_3 = VectorDisplay(Anchor=graft(project.Geometry), Vector=ln_2)

# ==== cluster Cluster_5
num_x_value = ClusterInput()
num_y_value = ClusterInput()
num_z_value = ClusterInput()
crv_new_y = ClusterInput()
crv_new_x = ClusterInput()
panel = Panel(""".3
.2""")
num_y_value_2 = Number(num_y_value)
crv_new_x_2 = Curve(crv_new_x)
num_x_value_2 = Number(num_x_value)
num_z_value_2 = Number(num_z_value)
crv_new_y_2 = Curve(crv_new_y)
Y = UnitY(Factor=num_z_value_2)
ext = Extend(Curve=crv_new_x_2, Type=0, Start=0, End=5)
dash = DashPattern(Curve=[ext, crv_new_y_2], Pattern=panel)  # -> Dashes, Gaps
eval = EvaluateLength(Curve=ext, Length=num_x_value_2, Normalized=False)  # -> Point, Tangent, Parameter
line = LineSDL(Start=eval.Point, Direction=crv_new_y_2, Length=num_y_value_2)
move = Move(Geometry=eval.Point, Motion=line)  # -> Geometry, Transform
offset = Offset(Curve=dash.Dashes, Distance=0.03, Plane=PlaneXY(0, 0, 0), Corners=1)
offset_2 = Offset(Curve=dash.Dashes, Distance=-0.03, Plane=PlaneXY(0, 0, 0), Corners=1)
move_2 = Move(Geometry=move.Geometry, Motion=Y)  # -> simplify(Geometry), Transform
loft = Loft(
    Curves=[offset, offset_2],
    Options={Adjust=False, Closed=False, Rebuild=10, Refit=0.01, LoftType=0, LoftEnds=0, LoftSimp=0})
panel_2 = Panel(""".15
.2""")
preview = CustomPreview(Geometry=loft, Shader=ColourSwatch(SwatchColor=RGB(0, 0, 0)))
path_mapper = PathMapper(move_2.Geometry, source=["{A;B;C;D}", "{A;B;C}"], target=["{A;B;C}", "{A;B}"])
pline = PolyLine(Vertices=path_mapper, Closed=False)
path_mapper_2 = PathMapper(pline, source=["{A;B;C}", "{A;B}"], target=["{A;B}", "{A}"])
join = JoinCurves(Curves=path_mapper_2, Preserve=False)
panel_3 = Panel("""0
6""")
panel_4 = Panel("""3
9""")
runion = RegionUnion(Curves=flatten(join))
offset_3 = Offset(Curve=runion, Distance=0.1, Plane=PlaneXY(0, 0, 0), Corners=1)
planar = PlanarSrf(Edges=flatten([offset_3, runion]))
item = ListItem(List=flatten(join), Index=panel_3, Wrap=False)
item_2 = ListItem(List=flatten(join), Index=panel_4, Wrap=False)
mesh = Mesh(planar)
planar_2 = PlanarSrf(Edges=flatten(item))
planar_3 = PlanarSrf(Edges=flatten(item_2))
Z = UnitZ(Factor=0.5)
Z_2 = UnitZ(Factor=0.5)
mesh_2 = ClusterOutput(mesh)
move_3 = Move(Geometry=planar_2, Motion=Z)  # -> Geometry, Transform
move_4 = Move(Geometry=planar_3, Motion=Z_2)  # -> Geometry, Transform
crv_axon_drawing = Curve(pline)
mesh_3 = Mesh(move_3.Geometry)
mesh_4 = Mesh(move_4.Geometry)
mesh_5 = ClusterOutput(mesh_3)
mesh_6 = ClusterOutput(mesh_4)
crv_axon_drawing_2 = ClusterOutput(crv_axon_drawing)

# ---- group: 1 - X Coordinate
point = Point(eval.Point)

# ---- group: 4 - Connect Points
preview_2 = CustomPreview(Geometry=crv_axon_drawing, Shader=ColourSwatch(SwatchColor=RGB(0, 0, 0)))

# ---- group: 2 - Y Coordinate
point_2 = Point(move.Geometry)

# ----
ln = Line(StartPoint=point, EndPoint=point_2)
dash_2 = DashPattern(Curve=ln, Pattern=panel_2)  # -> Dashes, Gaps

# ---- group: 2 - Y Coordinate (continued)
preview_3 = CustomPreview(Geometry=dash_2.Dashes, Shader=ColourSwatch(SwatchColor=RGB(255, 255, 255)))
vdis = VectorDisplay(Anchor=point, Vector=ln)

# ---- group: 3 - Z Coordinate
point_3 = Point(move_2.Geometry)

# ----
ln_2 = Line(StartPoint=point_2, EndPoint=point_3)
dash_3 = DashPattern(Curve=ln_2, Pattern=panel_2)  # -> Dashes, Gaps

# ---- group: 3 - Z Coordinate (continued)
preview_4 = CustomPreview(Geometry=dash_3.Dashes, Shader=ColourSwatch(SwatchColor=RGB(255, 255, 255)))
vdis_2 = VectorDisplay(Anchor=point_2, Vector=ln_2)
