# Grasshopper definition Cylindrical Projection-323994.gh (Grasshopper 0.9.14)

# ---- group: Inputs from Rhino
pt_drawing_location = Point(<point referenced from the Rhino model>)
pt_station_point = Point(<point referenced from the Rhino model>)
pipeline = GeometryPipeline(
    LayerFilter="Objects",
    NameFilter="*",
    TypeFilter=24,
    IncludeLocked=True,
    IncludeHidden=True,
    GroupByLayer=False,
    GroupByType=False)
crv_curves_for_projection_surface = Curve([<curve referenced from the Rhino model> x2])

# ---- group: Creates Vectors for Projection / Inputs
brep_objects_to_project = Brep(pipeline)
pt_station_point_2 = Point(pt_station_point)

# ---- group: Creates A Cylinder for Projection
pt_station_point_3 = Point(pt_station_point)
yz = YZPlane(Origin=pt_station_point_3)
xy = XYPlane(Origin=pt_station_point_3)
cyl = Cylinder(Base=xy, Radius=Slider(13, range=5..25), Length=Slider(417, range=0..1000))
srf_cylinder_for_projection = Surface(cyl)

# ---- group: Lofts Any Surface for Projection
crv_curves_for_projection_surface_2 = Curve(crv_curves_for_projection_surface)
loft = Loft(
    Curves=crv_curves_for_projection_surface_2,
    Options={Adjust=False, Closed=False, Rebuild=10, Refit=0.01, LoftType=0, LoftEnds=0, LoftSimp=0})
srf_projection_surface = Surface(loft)

# ---- group: Creates Vectors for Projection / Controls the Resolution of the Drawing
resolution = Slider(3, range=1..15)

# ---- group: Creates Vectors for Projection
explode = BrepComponents(Brep=brep_objects_to_project)  # -> Faces, graft(Edges), Vertices
len = Length(Curve=explode.Edges)
division = Division(A=len, B=resolution)
divide = DivideCurve(Curve=explode.Edges, Count=division, Kinks=False)  # -> Points, Tangents, Parameters
ln = Line(StartPoint=pt_station_point_2, EndPoint=divide.Points)

# ---- group: Creates Vectors for Projection / Outputs
crv_projection_vectors = Curve(ln)

# ---- group: Place Any Untrimmed Surface Here for Projection
srf_projection_surface_2 = Surface(srf_projection_surface)

# ---- group: Projects Objects Onto Surface / Inputs
crv_projection_vectors_2 = Curve(crv_projection_vectors)
pt_station_point_4 = Point(pt_station_point)
mesh_projection_plane = Mesh(srf_projection_surface_2)

# ---- group: Projects Objects Onto Surface
meshray = MeshRay(Mesh=mesh_projection_plane, Point=pt_station_point_4, Direction=crv_projection_vectors_2)  # -> Point, Hit
pline = PolyLine(Vertices=meshray.Point, Closed=False)

# ---- group: Projects Objects Onto Surface / Outputs
crv_projected_lines = Curve(pline)
pt_projection_points = Point(meshray.Point)

# ---- group: Draws Projection in Plan / Inputs
pt_drawing_location_2 = Point(pt_drawing_location)
pt_projection_points_2 = Point(pt_projection_points)
srf_projection_plane = Surface(srf_projection_surface_2)

# ---- group: Draws Projection in Plan
dim = Dimensions(Surface=srf_projection_plane)  # -> UDimension, VDimension
dom = Domain(DomainStart=0, DomainEnd=dim.UDimension)
dom_2 = Domain(DomainStart=0, DomainEnd=dim.VDimension)
srf_cp = SurfaceCP(Point=pt_projection_points_2, Surface=reparameterize(srf_projection_plane))  # -> Point, UVPoint, Distance
rectangle = Rectangle(Plane=pt_drawing_location_2, XSize=dom, YSize=dom_2, Radius=0)  # -> Rectangle, Length
eval = EvaluateSurface(Surface=reparameterize(rectangle.Rectangle), Point=srf_cp.UVPoint)  # -> Point, Normal, Frame
pline_2 = PolyLine(Vertices=eval.Point, Closed=False)

# ---- group: Draws Projection in Plan / Outputs
crv_projected_drawing = Curve(pline_2)
