# Grasshopper definition Descriptive Geometry-480340.gh (Grasshopper 0.9.14)

distance_between_drawings = Slider(20, range=5..25)
brep_object_to_draw = Brep([<brep referenced from the Rhino model> x2])

# ---- group: Creates and Orients Base Views
cluster = Cluster(brep_object_to_draw=brep_object_to_draw)  # -> pt_plan_projection_2, pt_elevation_projection_2
cluster_2 = Cluster_2(
    pt_plan_projection=cluster.pt_plan_projection_2,
    pt_elevation_projection=cluster.pt_elevation_projection_2,
    num_distance_between_drawings=distance_between_drawings)  # -> pt_plan_in_place_3, crv_plan_lines_3, line_seam_2, pt_plan_in_place_4, crv_plan_lines_4

# ----
seam_2_rotation = Slider(0, range=-90..0)
seam_2_rotation_2 = Slider(0, range=-90..0)
cluster_3 = Cluster_3(
    pt_plan_in_place=cluster_2.pt_plan_in_place_3,
    line_seam=cluster_2.line_seam_2,
    pt_elevation_in_place=cluster_2.pt_plan_in_place_4,
    num_distance_between_drawings=distance_between_drawings,
    num_seam_rotation=seam_2_rotation_2)  # -> pt_object_2, crv_object_2, line_seam_5
cluster_4 = Cluster_3(
    pt_plan_in_place=cluster_3.pt_object_2,
    line_seam=cluster_3.line_seam_5,
    pt_elevation_in_place=cluster_2.pt_plan_in_place_3,
    num_distance_between_drawings=distance_between_drawings,
    num_seam_rotation=seam_2_rotation)  # -> pt_object_2, crv_object_2, line_seam_5
panel = Panel("""3
2""")
dash = DashPattern(Curve=[cluster_3.line_seam_5, cluster_4.line_seam_5, cluster_2.line_seam_2], Pattern=panel)  # -> Dashes, Gaps
preview = CustomPreview(
    Geometry=[cluster_2.crv_plan_lines_3, cluster_2.crv_plan_lines_4, cluster_3.crv_object_2, dash.Dashes, cluster_4.crv_object_2],
    Shader=ColourSwatch(SwatchColor=RGB(0, 0, 0)))

# ==== cluster Cluster
brep_object_to_draw = ClusterInput()
brep_object_to_draw_2 = Brep(brep_object_to_draw)
sunion = SolidUnion(Breps=brep_object_to_draw_2)
fmerge = MergeFaces(Brep=sunion)  # -> Breps, Before, After
bbox = BoundingBox(Content=sunion, Plane=PlaneXY(0, 0, 0))  # -> Box, Box_2
explode = BrepComponents(Brep=bbox.Box)  # -> Faces, Edges, Vertices
explode_2 = BrepComponents(Brep=fmerge.Breps)  # -> Faces, Edges, Vertices
item = ListItem(List=explode.Vertices, Index=0, Wrap=False)
explode_3 = BrepComponents(Brep=explode_2.Faces)  # -> Faces, Edges, Vertices
explode_4 = Explode(Curve=explode_3.Edges, Recursive=True)  # -> Segments, Vertices
yz = YZPlane(Origin=item)
xy = XYPlane(Origin=item)
project = Project(Geometry=explode_4.Vertices, Plane=xy)  # -> Geometry, Transform
project_2 = Project(Geometry=explode_4.Vertices, Plane=yz)  # -> Geometry, Transform
orient = Orient(Geometry=project_2.Geometry, Source=yz, Target=xy)  # -> Geometry, Transform
bbox_2 = BoundingBox(Content=flatten(orient.Geometry), Plane=PlaneXY(0, 0, 0), UnionBox=True)  # -> Box, Box_2
bbox_3 = BoundingBox(Content=flatten(project.Geometry), Plane=PlaneXY(0, 0, 0), UnionBox=True)  # -> Box, Box_2
explode_5 = BrepComponents(Brep=bbox_2.Box)  # -> Faces, Edges, Vertices
item_2 = ListItem(List=explode_5.Vertices, Index=0, Wrap=False)
explode_6 = BrepComponents(Brep=bbox_3.Box)  # -> Faces, Edges, Vertices
rad = Radians(Degrees=90)
xy_2 = XYPlane(Origin=item_2)
item_3 = ListItem(List=explode_6.Vertices, Index=1, Wrap=False)
rotate = Rotate(Geometry=orient.Geometry, Angle=rad, Plane=xy_2)  # -> Geometry, Transform
bbox_4 = BoundingBox(Content=flatten(rotate.Geometry), Plane=PlaneXY(0, 0, 0), UnionBox=True)  # -> Box, Box_2
explode_7 = BrepComponents(Brep=bbox_4.Box)  # -> Faces, Edges, Vertices
item_4 = ListItem(List=explode_7.Vertices, Index=1, Wrap=False)
ln = Line(StartPoint=item_4, EndPoint=item_3)
move = Move(Geometry=rotate.Geometry, Motion=ln)  # -> Geometry, Transform
pt_plan_projection = Point(project.Geometry)
pt_elevation_projection = Point(move.Geometry)
pt_plan_projection_2 = ClusterOutput(pt_plan_projection)
pt_elevation_projection_2 = ClusterOutput(pt_elevation_projection)

# ==== cluster Cluster_2
num_distance_between_drawings = ClusterInput()
pt_elevation_projection = ClusterInput()
pt_plan_projection = ClusterInput()
num_distance_between_drawings_2 = Number(num_distance_between_drawings)
pt_elevation_projection_2 = Point(pt_elevation_projection)
pt_plan_projection_2 = Point(pt_plan_projection)
bbox = BoundingBox(Content=flatten(pt_plan_projection_2), Plane=PlaneXY(0, 0, 0), UnionBox=True)  # -> Box, Box_2
bbox_2 = BoundingBox(Content=flatten(pt_elevation_projection_2), Plane=PlaneXY(0, 0, 0), UnionBox=True)  # -> Box, Box_2
explode = BrepComponents(Brep=bbox.Box)  # -> Faces, Edges, Vertices
explode_2 = BrepComponents(Brep=bbox_2.Box)  # -> Faces, Edges, Vertices
item = ListItem(List=explode.Edges, Index=1, Wrap=False)
item_2 = ListItem(List=explode.Edges, Index=0, Wrap=False)
multiplication = Multiplication(A=num_distance_between_drawings_2, B=2)
item_3 = ListItem(List=explode_2.Edges, Index=0, Wrap=False)
len = Length(Curve=item_2)
len_2 = Length(Curve=item_3)
ma = MassAddition(Input=flatten([len_2, multiplication, len]))  # -> Result, PartialResults
addition = Addition(A=len, B=num_distance_between_drawings_2)
X = UnitX(Factor=addition)
move = Move(Geometry=item, Motion=X)  # -> Geometry, Transform
pframe = PerpFrame(Curve=reparameterize(move.Geometry), Parameter="{0.5,0,0}")
pcomp = PlaneComponents(Plane=pframe)  # -> Origin, XAxis, YAxis, ZAxis
amp = Amplitude(Vector=pcomp.YAxis, Amplitude=expr("A/2", num_distance_between_drawings_2))
X_2 = UnitX(Factor=ma.Result)
move_2 = Move(Geometry=pt_plan_projection_2, Motion=X)  # -> Geometry, Transform
pline = PolyLine(Vertices=move_2.Geometry, Closed=False)
move_3 = Move(Geometry=pt_elevation_projection_2, Motion=X_2)  # -> Geometry, Transform
move_4 = Move(Geometry=move.Geometry, Motion=amp)  # -> Geometry, Transform
pline_2 = PolyLine(Vertices=move_3.Geometry, Closed=False)
crv_plan_lines = Curve(pline)
pt_plan_in_place = Point(move_2.Geometry)
crv_plan_lines_2 = Curve(pline_2)
pt_plan_in_place_2 = Point(move_3.Geometry)
line_seam = Line(move_4.Geometry)
crv_plan_lines_3 = ClusterOutput(crv_plan_lines)
pt_plan_in_place_3 = ClusterOutput(pt_plan_in_place)
line_seam_2 = ClusterOutput(line_seam)
crv_plan_lines_4 = ClusterOutput(crv_plan_lines_2)
pt_plan_in_place_4 = ClusterOutput(pt_plan_in_place_2)

# ==== cluster Cluster_3
num_distance_between_drawings = ClusterInput()
pt_elevation_in_place = ClusterInput()
pt_plan_in_place = ClusterInput()
line_seam = ClusterInput()
num_seam_rotation = ClusterInput()
num_distance_between_drawings_2 = Number(num_distance_between_drawings)
pt_elevation_in_place_2 = Point(pt_elevation_in_place)
pt_plan_in_place_2 = Point(pt_plan_in_place)
line_seam_2 = Line(line_seam)
num_seam_rotation_2 = Number(num_seam_rotation)

# ---- group: Measures Distance from Orignal Seam line to second drawing
pframe = PerpFrame(Curve=reparameterize(line_seam_2), Parameter="{0.5,0,0}")
pcomp = PlaneComponents(Plane=pframe)  # -> Origin, XAxis, YAxis, ZAxis
line = LineSDL(Start=pt_elevation_in_place_2, Direction=pcomp.YAxis, Length=25)
llx = LineLine(Line1=line_seam_2, Line2=line)  # -> ParamA, ParamB, PointA, PointB
dist = Distance(PointA=graft(pt_elevation_in_place_2), PointB=graft(llx.PointA))
num_distance_1 = Number(dist)

# ----
panel = Panel("""3
2""")
dash = DashPattern(Curve=line_seam_2, Pattern=panel)  # -> Dashes, Gaps
pline = PolyLine(Vertices=pt_elevation_in_place_2, Closed=False)
pline_2 = PolyLine(Vertices=pt_plan_in_place_2, Closed=False)
panel_2 = Panel("""3
2""")
preview = CustomPreview(Geometry=[pline_2, pline], Shader=ColourSwatch(SwatchColor=RGB(0, 0, 0)))

# ---- group: 3 -Seam Line 2
swatch = ColourSwatch(SwatchColor=RGB(0, 0, 0))
preview_2 = CustomPreview(Geometry=dash.Dashes, Shader=swatch)

# ---- group: 4 - Measuring Distance from Seam Line
pt = Point(llx.PointA)
pt_2 = Point(pt_elevation_in_place_2)
ln = Line(StartPoint=graft(pt_elevation_in_place_2), EndPoint=graft(llx.PointA))
flip = Flip(Curve=ln)  # -> Curve, Flag
vdis = VectorDisplay(Anchor=flatten(pt_2), Vector=flatten(ln))
vdis_2 = VectorDisplay(Anchor=pt_2, Vector=flip.Curve)

# ---- group: Makes Seam for Translation
xy = XYPlane(Origin=Point(0, 0, 0))
bbox = BoundingBox(Content=flatten(pt_plan_in_place_2), Plane=PlaneXY(0, 0, 0), UnionBox=True)  # -> Box, Box_2
explode = BrepComponents(Brep=bbox.Box)  # -> Faces, Edges, Vertices
item = ListItem(List=explode.Edges, Index=2, Wrap=False)
pframe_2 = PerpFrame(Curve=reparameterize(item), Parameter="{0.5,0,0}")
pcomp_2 = PlaneComponents(Plane=pframe_2)  # -> Origin, XAxis, YAxis, ZAxis
amp = Amplitude(Vector=pcomp_2.YAxis, Amplitude=expr("A/2", num_distance_between_drawings_2))
move = Move(Geometry=item, Motion=amp)  # -> Geometry, Transform
rad = Radians(Degrees=num_seam_rotation_2)
rotate = Rotate(Geometry=xy, Angle=rad, Plane=xy)  # -> Geometry, Transform
ext = Extend(Curve=move.Geometry, Type=0, Start=expr("L0/2", num_distance_between_drawings_2), End=0)
end = EndPoints(Curve=ext)  # -> Start, End
xy_2 = XYPlane(Origin=end.Start)
rotate_2 = Rotate(Geometry=move.Geometry, Angle=rad, Plane=xy_2)  # -> Geometry, Transform

# ---- group: Projects Drawing Points to Seam line
curvepoint = PointOnCurve(rotate_2.Geometry, parameter=0.5)
Z = UnitZ(Factor=1)
move_2 = Move(Geometry=curvepoint, Motion=Z)  # -> Geometry, Transform
ln_2 = Line(StartPoint=curvepoint, EndPoint=move_2.Geometry)
pl = Plane(Origin=curvepoint, XAxis=rotate_2.Geometry, YAxis=ln_2)
pcomp_3 = PlaneComponents(Plane=pl)  # -> Origin, XAxis, YAxis, ZAxis
line_2 = LineSDL(Start=pt_plan_in_place_2, Direction=pcomp_3.ZAxis, Length=-25)
llx_2 = LineLine(Line1=line_2, Line2=rotate_2.Geometry)  # -> ParamA, ParamB, graft(PointA), graft(PointB)
pt_3 = Point(llx_2.PointB)

# ----
ext_2 = Extend(Curve=rotate_2.Geometry, Type=0, Start=12, End=0)

# ---- group: Makes Seam for Translation (continued)
dash_2 = DashPattern(Curve=ext_2, Pattern=panel_2)  # -> Dashes, Gaps

# ---- group: Moves points for the new view
abs = Absolute(Value=pcomp_3.ZAxis)
amp_2 = Amplitude(Vector=abs, Amplitude=simplify(num_distance_1))
rev = Reverse(Vector=amp_2)
move_3 = Move(Geometry=simplify(pt_3), Motion=amp_2)  # -> Geometry, Transform
path_mapper = PathMapper(move_3.Geometry, source="{A;B;C}", target="{A;B}")
pline_3 = PolyLine(Vertices=path_mapper, Closed=False)
line_seam_3 = Line(rotate_2.Geometry)

# ----
pt_object = Point(path_mapper)

# ---- group: 1 -Seam Line 1
swatch_2 = ColourSwatch(SwatchColor=RGB(0, 0, 0))
preview_3 = CustomPreview(Geometry=dash_2.Dashes, Shader=swatch_2)

# ----
crv_object = Curve(pline_3)
line_seam_4 = Line(line_seam_3)
pt_object_2 = ClusterOutput(pt_object)
crv_object_2 = ClusterOutput(crv_object)
line_seam_5 = ClusterOutput(line_seam_4)

# ---- group: 2 - Project Points
ln_3 = Line(StartPoint=graft(pt_plan_in_place_2), EndPoint=llx_2.PointB)
pt_4 = Point(pt_3)

# ----
vdis_3 = VectorDisplay(Anchor=flatten(pt_plan_in_place_2), Vector=flatten(ln_3))

# ---- group: 5- Move Points By Distance from Seam Line
vdis_4 = VectorDisplay(Anchor=flatten(pt_2), Vector=flatten(ln))
vdis_5 = VectorDisplay(Anchor=pt_2, Vector=flip.Curve)
preview_4 = CustomPreview(Geometry=dash.Dashes, Shader=swatch)
vdis_6 = VectorDisplay(Anchor=flatten(move_3.Geometry), Vector=flatten(rev))
pt_5 = Point(move_3.Geometry)
preview_5 = CustomPreview(Geometry=dash_2.Dashes, Shader=swatch_2)
pt_6 = Point(pt_3)
vdis_7 = VectorDisplay(Anchor=pt_6, Vector=amp_2)

# ---- group: 5 - Connect the Points
preview_6 = CustomPreview(Geometry=dash.Dashes, Shader=swatch)
preview_7 = CustomPreview(Geometry=pline_3, Shader=swatch)
preview_8 = CustomPreview(Geometry=dash_2.Dashes, Shader=swatch_2)
