# Grasshopper definition Export to Google Earth - Wilson-560440.gh (Grasshopper 0.9.14)
# plug-ins: gHowl

# ----
# "Insert Location" needs to be the same loction in your rhino model as the pin that you use to get longitude and lattidue in Google Earth
pt_insert_location = Point(<point referenced from the Rhino model>)

# ----
# Object needs to be converted to a mesh for export
mesh_object_to_export = Mesh(<mesh referenced from the Rhino model>)

# ----
# Google earth is metric. If rhino is in imperial units, you need to scale it before exporting
panel = Panel("0.3048")
scale = Scale(Geometry=mesh_object_to_export, Center=pt_insert_location, Factor=panel)  # -> Geometry, Transform

# ----
# Longitude, Latitude, Altitude. Use decimal degrees. To set decimal degrees in google earth go to tools -> options -> 3D view - > Show Lat/Long. Google earth lists coordinates latitude/longitude, the kml export is looking for the reverse: longitude/latitude.
# 
# If you use elevation in google earth for the altitude select "Absolute" from the value list below. If you use 0 as the altitude select "relativeToground."
list = ValueList(
    {"Absolute": "absolute", "clamToground": "clamToGround", "relativeToground": "relativeToGround"}, selected=[],
    ListIndex=2,
    UIMode=1)

# ----
# You can set fill color and line weight and color in grasshopper. However, you can also set it in an objects properties in Google Earth
swatch = ColourSwatch(SwatchColor=RGB(255, 255, 255))
S = KMLStyle(FillColor=swatch, CurveColor=swatch, CurveWidth=Slider(0, range=0..100))

# ----
# File path of where you want the kmz file to export with \Your file name.kmz
panel_2 = Panel("File Path\File Name.kmz")

kml_out = KMLExporter(
    FilePath=panel_2,
    Geometry=scale.Geometry,
    Style=S,
    EAP_XYZ=pt_insert_location,
    EAP_GPS="-73.979076, 40.752859, 0",
    AltitudeMode=list)
