# Grasshopper definition Sketch 1 - Angles-944591.gh (Grasshopper 0.9.14)

crv_3 = Curve([<curve referenced from the Rhino model> x4])
crv_1 = Curve([<curve referenced from the Rhino model> x4])
crv_2 = Curve([<curve referenced from the Rhino model> x4])
angle = Angle(VectorA=crv_1, VectorB=crv_2)  # -> Angle, Reflex
angle_2 = Angle(VectorA=crv_1, VectorB=crv_3)  # -> Angle, Reflex
angle_3 = Angle(VectorA=crv_2, VectorB=crv_3)  # -> Angle, Reflex
curvepoint = PointOnCurve(crv_2, parameter=1)
deg = Degrees(Radians=angle.Angle)
deg_2 = Degrees(Radians=angle_2.Angle)
deg_3 = Degrees(Radians=angle_3.Angle)
curvepoint_2 = PointOnCurve(crv_1, parameter=1)
curvepoint_3 = PointOnCurve(crv_3, parameter=1)
panel = Panel(deg)
panel_2 = Panel(deg_2)
panel_3 = Panel(deg_3)
int = Integer(panel_2)
int_2 = Integer(panel_3)
int_3 = Integer(panel)
tag = TextTag3D(Location=curvepoint, Text=int, Size=0.125, Colour=ColourSwatch(SwatchColor=RGB(0, 0, 0)))
tag_2 = TextTag3D(Location=curvepoint_3, Text=int_2, Size=0.125, Colour=ColourSwatch(SwatchColor=RGB(0, 0, 0)))
tag_3 = TextTag3D(Location=curvepoint_2, Text=int_3, Size=0.125, Colour=ColourSwatch(SwatchColor=RGB(0, 0, 0)))
