# Grasshopper definition Spherical Projection-722066.gh (Grasshopper 0.9.14)

# ---- group: Inputs from Rhino
pt_drawing_location = Point(<point referenced from the Rhino model>)
pt_station_point = Point(<point referenced from the Rhino model>)
pipeline = GeometryPipeline(
    LayerFilter="Objects",
    NameFilter="*",
    TypeFilter=24,
    IncludeLocked=True,
    IncludeHidden=True,
    GroupByLayer=False,
    GroupByType=False)

# ---- group: Creates Vectors for Projection / Inputs
brep_objects_to_project = Brep(pipeline)
pt_station_point_2 = Point(pt_station_point)

# ---- group: Creates Sphere for Projection
pt_station_point_3 = Point(pt_station_point)
sph = Sphere(Base=pt_station_point_3, Radius=Slider(11, range=1..20))
srf = Surface(sph)

# ---- group: Creates Vectors for Projection / Controls the Resolution of the Drawing
resolution = Slider(3, range=1..15)

# ---- group: Creates Vectors for Projection
explode = BrepComponents(Brep=brep_objects_to_project)  # -> Faces, graft(Edges), Vertices
len = Length(Curve=explode.Edges)
division = Division(A=len, B=resolution)
divide = DivideCurve(Curve=explode.Edges, Count=division, Kinks=False)  # -> Points, Tangents, Parameters
ln = Line(StartPoint=pt_station_point_2, EndPoint=divide.Points)

# ---- group: Creates Vectors for Projection / Outputs
crv_projection_vectors = Curve(ln)

# ---- group: Place Any Untrimmed Surface Here for Projection
srf_projection_surface = Surface(srf)

# ---- group: Projects Objects Onto Surface / Inputs
crv_projection_vectors_2 = Curve(crv_projection_vectors)
pt_station_point_4 = Point(pt_station_point)
mesh_projection_plane = Mesh(srf_projection_surface)

# ---- group: Projects Objects Onto Surface
meshray = MeshRay(Mesh=mesh_projection_plane, Point=pt_station_point_4, Direction=crv_projection_vectors_2)  # -> Point, Hit
pline = PolyLine(Vertices=meshray.Point, Closed=False)

# ---- group: Projects Objects Onto Surface / Outputs
pt_projection_points = Point(meshray.Point)
crv_projected_lines = Curve(pline)

# ---- group: Draws spherical projection in plan / Inputs
srf_projection_plane = Surface(srf)
pt_drawing_location_2 = Point(pt_drawing_location)
pt_projection_points_2 = Point(pt_projection_points)

# ---- group: Draws spherical projection in plan
srf_cp = SurfaceCP(Point=pt_projection_points_2, Surface=reparameterize(srf_projection_plane))  # -> Point, UVPoint, Distance
pcomp = Decompose(Point=srf_cp.UVPoint, System=PlaneXY(0, 0, 0))  # -> XComponent, YComponent, ZComponent
radius_of_drawing = Slider(115, range=50..200)
dom = Domain(DomainStart=0, DomainEnd=360)
subtraction = Subtraction(A=1, B=pcomp.YComponent)
dom_2 = Domain(DomainStart=0, DomainEnd=radius_of_drawing)
remap = RemapNumbers(Value=pcomp.XComponent, Source=Domain(0, 1), Target=dom)
remap_2 = RemapNumbers(Value=subtraction, Source=Domain(0, 1), Target=dom_2)
rad = Radians(Degrees=remap)
Y = UnitY(Factor=1)
line = LineSDL(Start=pt_drawing_location_2, Direction=Y, Length=remap_2)
rotate = Rotate(Geometry=line, Angle=rad, Plane=pt_drawing_location_2)  # -> Geometry, Transform
end = EndPoints(Curve=rotate.Geometry)  # -> Start, End
pline_2 = PolyLine(Vertices=end.End, Closed=False)

# ---- group: Draws spherical projection in plan / Outputs
crv_spherical_projection = Curve(pline_2)
